# Grasshopper definition unnamed.gh (Grasshopper 1.0.7)
# plug-ins: Dragonfly

fclock = FlyClock(SecondHand=True)
series = Series(Start=0, Step=10, Count=8)
set_camera = SetCamera(
    Times=series,
    NamedViews=[null x8],
    Lens=22,
    Offset=Vector(0, 0, 0),
    Times_2=series,
    NamedViews_2=[null x8],
    m_rfp=True,
    dck0_m_rfp=True,
    dcv0_boolean=False,
    dck1_m_rfp=True,
    dcv1_boolean=True)
knob = ControlKnob(Decimals=0, Limit=True, Maximum=100, Minimum=0, Range=100, Value=0)
